# Grasshopper definition Advanced_01_SIMPLE.gh (Grasshopper 1.0.8)

width = Slider(8, range=1..12)
wall_axis = Curve(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)
offset = OffsetCurve(Curve=wall_axis, Distance=width, Corners=1)
rows = Slider(6, range=1..12)
columns = Slider(42, range=1..100)
loft = Loft(
    Curves=flatten([wall_axis, offset]),
    Options={Adjust=False, Closed=False, LoftEnds=0, LoftSimp=0, LoftType=0, Rebuild=10, Refit=0.01})
step_height = Slider(0.834, range=0.5..6)
divide = DivideDomain²(Domain=loft, UCount=rows, VCount=columns)
subsrf = Isotrim(Surface=loft, Domain=divide)
series = Series(Start=step_height, Step=step_height, Count=rows)
partition = PartitionList(List=subsrf, Size=columns)
Z = UnitZ(Factor=series)
extr = Extrude(Base=partition, Direction=graft(Z))
subtraction = Subtraction(A=columns, B=1)
step = Slider(0, range=0..91)
series_2 = Series(Start=subtraction, Step=columns, Count=rows)
series_3 = Series(Start=0, Step=1, Count=subtraction)
rev = ReverseList(List=[series_3, series_2])
drop_ends = CullIndex(List=rev, Indices=[0, -1], Wrap=True)
item = ListItem(List=flatten([series_3, series_2, drop_ends]), Index=step, Wrap=True)
item_2 = ListItem(List=flatten(extr), Index=item, Wrap=True)
cull_i = CullIndex(List=flatten(extr), Indices=item, Wrap=True)
red = ColourSwatch(SwatchColor=RGB(230, 0, 0))
blue = ColourSwatch(SwatchColor=RGBA(40, 90, 210, 110))
preview = CustomPreview(Geometry=cull_i, Material=blue)
preview_2 = CustomPreview(Geometry=item_2, Material=red)
