# Grasshopper definition Advanced_01_stepped_wall.gh (Grasshopper 1.0.8)

start = Slider(0, range=0..10)
xstep = Slider(10, range=1..30)
pts = Slider(10, range=4..30)
wave = Slider(0.7, range=0.1..2)
series = Series(Start=start, Step=xstep, Count=pts)
series_2 = Series(Start=start, Step=wave, Count=pts)
amp = Slider(15, range=1..40)
sin = Sine(Value=series_2)
multiplication = Multiplication(A=sin, B=amp)
width = Slider(8, range=1..40)
corners = Slider(1, range=0..4)
d0 = Slider(0, range=0..1)
d1 = Slider(1, range=0..1)
pt = ConstructPoint(XCoordinate=series, YCoordinate=multiplication, ZCoordinate=0)
intcrv = Interpolate(Vertices=pt, Degree=3, Periodic=False, KnotStyle=1)  # -> Curve, Length, Domain
u_along = Slider(50, range=1..200)
v_rows = Slider(6, range=1..20)
h_start = Slider(1, range=0..5)
h_step = Slider(1, range=0..5)
base_h = Slider(2, range=0.1..10)
offset = OffsetCurve(Curve=intcrv.Curve, Distance=width, Corners=corners)
merge = Merge(Data1=intcrv.Curve, Data2=offset)
series_3 = Series(Start=h_start, Step=h_step, Count=v_rows)
dom = ConstructDomain(DomainStart=d0, DomainEnd=d1)
flatten = FlattenTree(Tree=merge, Path="{0}")
crvdom = CurveDomain(Curve=flatten, Domain=dom)  # -> Curve, Domain
multiplication_2 = Multiplication(A=series_3, B=base_h)
dom²num = ConstructDomain²(UMin=d0, UMax=d1, VMin=d0, VMax=d1)
loft = Loft(Curves=crvdom.Curve, Options={Adjust=False, Closed=False, LoftEnds=0, LoftSimp=0, LoftType=0, Rebuild=10, Refit=0.01})
Z = UnitZ(Factor=multiplication_2)
divide = DivideDomain²(Domain=dom²num, UCount=v_rows, VCount=u_along)
graft = GraftTree(Tree=Z, IncludeEmptyLists=True, IncludeNullItems=True)
subsrf = Isotrim(Surface=reparameterize(loft), Domain=divide)
partition = PartitionList(List=subsrf, Size=u_along)
extr = Extrude(Base=partition, Direction=graft)
flatten_2 = FlattenTree(Tree=extr, Path="{0}")
row_start = Slider(2, range=0..5)
row_step = Slider(1, range=1..5)
row_count = Slider(1, range=1..6)
col_start = Slider(12, range=0..49)
col_step = Slider(1, range=1..10)
col_count = Slider(1, range=1..50)
series_4 = Series(Start=row_start, Step=row_step, Count=row_count)
series_5 = Series(Start=col_start, Step=col_step, Count=col_count)
graft_2 = GraftTree(Tree=series_4, IncludeEmptyLists=True, IncludeNullItems=True)
_255 = Slider(255, range=0..255)
_0 = Slider(0, range=0..255)
blue_alpha = Slider(90, range=0..255)
blue_g = Slider(90, range=0..255)
blue_b = Slider(200, range=0..255)
multiplication_3 = Multiplication(A=graft_2, B=u_along)
addition = Addition(A=multiplication_3, B=series_5)
rgb = ColourRGB(Alpha=_255, Red=_255, Green=_0, Blue=_0)
rgb_2 = ColourRGB(Alpha=blue_alpha, Red=_0, Green=blue_g, Blue=blue_b)
flatten_3 = FlattenTree(Tree=addition, Path="{0}")
item = ListItem(List=flatten_2, Index=flatten_3, Wrap=True)
cull_i = CullIndex(List=flatten_2, Indices=flatten_3, Wrap=True)
preview = CustomPreview(Geometry=item, Material=rgb)
preview_2 = CustomPreview(Geometry=cull_i, Material=rgb_2)
